# Grasshopper definition gHowl_UDP_send+receive.ghx (Grasshopper 0.9.75)
# plug-ins: gHowl

port = Panel("7001")
udp_owl = UDPReceiver(Port=port, Pattern=0)  # -> Info, Data
panel = Panel(udp_owl.Data)
split = StringSplit(String=udp_owl.Data, Separators=";")
split_2 = SplitList(List=split, Index=Slider(2, range=0..20))  # -> ListA, ListB
xy = XYPlane(Origin=Point(0, 0, 0))
panel_2 = Panel(split_2.ListB)
panel_3 = Panel(split_2.ListA)
rectangle = Rectangle(Plane=xy, XSize=split_2.ListA, YSize=split_2.ListB, Radius=0)  # -> Rectangle, Length
panel_4 = Panel(rectangle.Rectangle)
box = CenterBox(Base=PlaneXY(0, 0, 0), X=1, Y=1, Z=1)
